# Grasshopper definition hbph_test_models.gh (Grasshopper 1.0.7)

planesrf = PlaneSurface(Plane="1,1,0", XSize="1", YSize="1")
planesrf_2 = PlaneSurface(Plane="2,2,0", XSize="1", YSize="1")
merge = Merge(Data1=planesrf, Data2=planesrf_2)  # -> graft(Result)

planesrf_3 = PlaneSurface(Plane="1,1,0", XSize="1", YSize="1")
planesrf_4 = PlaneSurface(Plane="2,2,0", XSize="1", YSize="1")
merge_2 = Merge(Data1=planesrf_3, Data2=planesrf_4)  # -> graft(Result)

path = FilePath("/Users/em/Dropbox/bldgtyp-00/00_PH_Tools/PHX/tests/_source_hbjson/")
data = Data(path)
data_2 = Data(Toggle(False))
data_3 = Data("2")

box = Box2Pt(PointA="0,0,0", PointB="5,4,3", Plane=PlaneXY(0, 0, 0))
box_2 = Box2Pt(PointA="5,0,0", PointB="12,4,3", Plane=PlaneXY(0, 0, 0))
roomsolid = HBRoomFromSolid(geo=flatten([box, box_2]), conditioned=True)  # -> report, rooms; plug-in component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
solveadj = HBSolveAdjacency(rooms=flatten(roomsolid.rooms), run=Toggle(True))  # -> report, adj_rooms; plug-in component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
hbph_phius_climate = HBPHPhiusClimate()  # -> out, ph_climate; inputs copy_from_excel: list
# ---------- hbph_phius_climate: Python ----------
#
# Honeybee-PH: A Plugin for adding Passive-House data to LadybugTools Honeybee-Energy Models
# 
# This component is part of the PH-Tools toolkit <https://github.com/PH-Tools>.
# 
# Copyright (c) 2022, PH-Tools and bldgtyp, llc <phtools@bldgtyp.com> 
# Honeybee-PH is free software; you can redistribute it and/or modify 
# it under the terms of the GNU General Public License as published 
# by the Free Software Foundation; either version 3 of the License, 
# or (at your option) any later version. 
# 
# Honeybee-PH is distributed in the hope that it will be useful,
# but WITHOUT ANY WARRANTY; without even the implied warranty of 
# MERCHANTABILITY or FITNESS FOR A PARTICULAR PURPOSE. See the 
# GNU General Public License for more details.
# 
# For a copy of the GNU General Public License
# see <https://github.com/PH-Tools/honeybee_ph/blob/main/LICENSE>.
# 
# @license GPL-3.0+ <http://spdx.org/licenses/GPL-3.0+>
#
"""
Assign Honeybee Rooms to a specific 'Buildiing Segment' within the PHX Model. In WUFI, this is used
as the 'Case', while in C3RRO this will be considered the 'Variant'. For PHIUS
projects, use this component to break mixed-use projects into separate residential-case
and non-residential-case variants.
-
EM April 8, 2022
    Args:
        name_:
        latitude_: (deg) default = 40.6 (NYC)
        longitude_: (deg) default = -73.8 (NYC)
        altitude_: (m) default = 5.0
        daily_temp_variation_: (deg K) default = 8.0K
        avg_wind_speed_: (m/s) default = 4.0 m/s
        copy_from_excel_: Copy/Paste from a PHPP-Style Climate data. Copy the 
            yellow cells (not the top line with ID / long / lat and not the left
            column with headings.) default = NYC Climate.
    
    Returns:
        ph_climate_: A new PHX Climate Object. Apply this to a WUFI Config PyPH Component.
"""

import honeybee_ph.location
import honeybee_ph_utils.preview
import honeybee_ph_rhino.climate

# --
import honeybee_ph_rhino._component_info_
reload(honeybee_ph_rhino._component_info_)
ghenv.Component.Name = "HBPH - Phius Climate"
DEV = True
honeybee_ph_rhino._component_info_.set_component_params(ghenv, dev='APR_08_2022')

if DEV:
    reload(honeybee_ph.location)
    reload(honeybee_ph_utils.preview)
    reload(honeybee_ph_rhino.climate)

# -- Climate
ph_climate_ = honeybee_ph.location.Climate()
ph_climate_.name = name_ or '__unnamed_location__'
ph_climate_.summer_daily_temperature_swing = daily_temp_variation_ or 8.0
ph_climate_.average_wind_speed = avg_wind_speed_ or 4

# -- Location
ph_climate_.location.latitude = latitude_ or 40.6
ph_climate_.location.longitude = longitude_ or -73.8
ph_climate_.location.weather_station_elevation = altitude_ or 5.0
ph_climate_.location.climate_zone = 1
ph_climate_.location.hours_from_UTC = -4

# -- Monthly
ph_climate_.monthly_temperature_air.values = [1.2,-0.2,5.6,10.9,16.1,21.7,25.0,24.8,19.9,14.0,7.3,3.3]
ph_climate_.monthly_temperature_dewpoint.values = [-4.3,-7.4,0.3,4.7,9.1,15.8,20.3,17.1,13.2,7.9,2.1,-2.8]
ph_climate_.monthly_temperature_sky.values = [-17.4,-20.0,-10.9,-4.8,1.0,9.8,14.5,8.4,5.8,-2.8,-8.6,-11.4]

ph_climate_.monthly_radiation_north.values = [21,29,34,39,56,60,59,50,34,30,20,16]
ph_climate_.monthly_radiation_east.values = [32,46,57,65,82,76,78,84,60,54,33,28]
ph_climate_.monthly_radiation_south.values = [83,106,103,86,80,73,78,104,97,129,87,87]
ph_climate_.monthly_radiation_west.values = [48,70,92,95,114,121,120,130,91,94,47,45]
ph_climate_.monthly_radiation_global.values = [50,72,111,133,170,176,177,182,124,109,62,46]

# -- Peak Loads
ph_climate_.peak_heating_1.temp = -6.7
ph_climate_.peak_heating_1.rad_north = 46
ph_climate_.peak_heating_1.rad_east = 80
ph_climate_.peak_heating_1.rad_south = 200
ph_climate_.peak_heating_1.rad_west = 113
ph_climate_.peak_heating_1.rad_global = 121

ph_climate_.peak_heating_2.temp = -4.2
ph_climate_.peak_heating_2.rad_north = 16
ph_climate_.peak_heating_2.rad_east = 22
ph_climate_.peak_heating_2.rad_south = 46
ph_climate_.peak_heating_2.rad_west = 26
ph_climate_.peak_heating_2.rad_global = 38

ph_climate_.peak_cooling_1.temp = 26.1
ph_climate_.peak_cooling_1.rad_north = 64
ph_climate_.peak_cooling_1.rad_east = 106
ph_climate_.peak_cooling_1.rad_south = 132
ph_climate_.peak_cooling_1.rad_west = 159
ph_climate_.peak_cooling_1.rad_global = 230

ph_climate_.peak_cooling_2.temp = 26.1
ph_climate_.peak_cooling_2.rad_north = 64
ph_climate_.peak_cooling_2.rad_east = 106
ph_climate_.peak_cooling_2.rad_south = 132
ph_climate_.peak_cooling_2.rad_west = 159
ph_climate_.peak_cooling_2.rad_global = 230

if copy_from_excel_:
    ph_climate_ = honeybee_ph_rhino.climate.parse_copy_from_excel(ph_climate_, copy_from_excel_)

# -- Preview
honeybee_ph_utils.preview.object_preview(ph_climate_)
# ---------- end hbph_phius_climate ----------
aperturesbyratio = HBAperturesByRatio(hb_objs=flatten(solveadj.adj_rooms), ratio="0.45", subdivide=Toggle(False))  # -> report, hb_objs; plug-in component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
ph_bldg_segment = HBPHBldgSegment(climate=hbph_phius_climate.ph_climate, hb_rooms=simplify(flatten(aperturesbyratio.hb_objs)))  # -> out, hb_rooms; inputs num_floor_levels: Int32, num_dwelling_units: Int32, source_energy_factors: list, co2e_factors: list, hb_rooms: list
#   port segment_name: (str) The name to give the new Honeybee Room.
#   port hb_rooms: (list) The Honeybee Rooms that you would like to join into a new single Room.
# ---------- ph_bldg_segment: Python ----------
#
# Honeybee-PH: A Plugin for adding Passive-House data to LadybugTools Honeybee-Energy Models
# 
# This component is part of the PH-Tools toolkit <https://github.com/PH-Tools>.
# 
# Copyright (c) 2022, PH-Tools and bldgtyp, llc <phtools@bldgtyp.com> 
# Honeybee-PH is free software; you can redistribute it and/or modify 
# it under the terms of the GNU General Public License as published 
# by the Free Software Foundation; either version 3 of the License, 
# or (at your option) any later version. 
# 
# Honeybee-PH is distributed in the hope that it will be useful,
# but WITHOUT ANY WARRANTY; without even the implied warranty of 
# MERCHANTABILITY or FITNESS FOR A PARTICULAR PURPOSE. See the 
# GNU General Public License for more details.
# 
# For a copy of the GNU General Public License
# see <https://github.com/PH-Tools/honeybee_ph/blob/main/LICENSE>.
# 
# @license GPL-3.0+ <http://spdx.org/licenses/GPL-3.0+>
#
"""
Use this component to add one or more honeybee-Rooms to a PH-Building-Segment. This 
'building-segment' could be a single floor, a 'wing' or an entire building and will 
map to a single 'Case' in WUFI or a single PHPP file.
-
Since Passive House models only allow for a single thermal zone, any honeybee-rooms 
that are part of the building-segment will be merged / joined when exported to 
WUFI-Passive or PHPP. When merged, only the exterior surfaces will be retained, and 
any faces with a 'Surface' boundary condition well be removed from the Passive House 
model. Only Honeybee Faces with boundary conditions of "Outdoors", "Ground" and 
"Adiabatic" will be included in the new Honeybee Room. 
-
Use this before passing the honeybee-rooms on to the 'HB Model' component.
-
EM June 7, 2022
    Args:
        segment_name_: Name for the building-segment
               
        num_floor_levels_: (int) Total number of floor levels for the group of 
            Honeybee rooms input. Default=1
        
        num_dwelling_units_: (int) Total number of 'units' for the group of Honeybee rooms
            input For residential, this is the total number of dwelling units
            in the group of HB-Room. For non-residential, leave this set to "1".
        
        climate_: Optional Passive House monthly climate data.
        
        source_energy_factors_: (Optional) A list of source energy (site->source) energy 
            factors to use for assessing overall source (primary) energy usage. By default, 
            this component will use the standard Phius 2021 source energy factors which can be 
            found at https://www.phius.org/PHIUS+2021/Phius%20Core_Phius%20Zero_Final%20Modeling%20Protocol%20v1.1.pdf
            -
            Use the "Create Conversion Factor" component to define custom factors if you would 
            like to use your own. Be sure to define all of the fuel-factors required by Phius / WUFI.

        co2e_factors_: (Optional) A list of CO2e (site->CO2e) conversion 
            factors to use for assessing overall GHG emissions. By default, 
            this component will use the standard Phius 2021 CO2e factors which can be 
            found at https://www.phius.org/PHIUS+2021/Phius%20Core_Phius%20Zero_Final%20Modeling%20Protocol%20v1.1.pdf
            -
            Use the "Create Conversion Factor" component to define custom factors if you would 
            like to use your own. Be sure to define all of the fuel-factors required by Phius / WUFI.
        
        phius_certification_: Optional Phius certification thresholds.
        
        phi_certification_: Optional PHI certification configuration and settings.
        
        winter_set_temp_: default = 20C [68F]
        
        summer_set_temp_: default = 25C [77F]
    
    Returns:
        hb_rooms_: The honeyee-Rooms with building-segment information added.
"""

from honeybee_ph_standards.sourcefactors import phius_CO2_factors, phius_source_energy_factors
from honeybee_ph_utils import preview
from honeybee_ph_rhino.gh_compo_io import ghio_bldg_segment


# ------------------------------------------------------------------------------------
import honeybee_ph_rhino._component_info_
reload(honeybee_ph_rhino._component_info_)
ghenv.Component.Name = "HBPH - Bldg Segment"
DEV = True
honeybee_ph_rhino._component_info_.set_component_params(ghenv, dev='JUN_07_2022')
if DEV:
    #reload(honeybee_ph.bldg_segment) # Breaks everyting.... sigh: Python 2
    reload(phius_CO2_factors)
    reload(phius_source_energy_factors)
    reload(ghio_bldg_segment)
    reload(preview)


# ------------------------------------------------------------------------------------
# Clean and collect the user inputs, build the new Building Segment
compo_input = ghio_bldg_segment.IBldgSegment()

compo_input.display_name = _segment_name_
compo_input.num_floor_levels = num_floor_levels_
compo_input.num_dwelling_units = num_dwelling_units_
compo_input.climate = climate_
compo_input.phius_certification = phius_certification_
compo_input.phi_certification = phi_certification_
compo_input.set_points.winter = winter_set_temp_
compo_input.set_points.summer = summer_set_temp_
compo_input.source_energy_factors = source_energy_factors_
compo_input.co2e_factors = co2e_factors_

segment = compo_input.create_hbph_bldg_segment()


# ------------------------------------------------------------------------------------
# -- Validate the CO2 and Source Energy Factors input
ALLOWED_FUELS = list(set(
    list(phius_source_energy_factors.factors_2021.keys()) +
    list(phius_CO2_factors.factors_2021.keys())
))

segment.source_energy_factors.validate_fuel_types(ALLOWED_FUELS)
segment.co2e_factors.validate_fuel_types(ALLOWED_FUELS)


# ------------------------------------------------------------------------------------
# -- Adcd the new segment to the Honeybee rooms
hb_rooms_ = []
for i, hb_room in enumerate(_hb_rooms):
    new_room = hb_room.duplicate()
    new_room.properties.ph.ph_bldg_segment = segment
    hb_rooms_.append(new_room)
    
    
# ------------------------------------------------------------------------------------
# -- Preview
preview.object_preview(segment)
# ---------- end ph_bldg_segment ----------
model = HBModel(rooms=flatten(ph_bldg_segment.hb_rooms))  # -> report, model; plug-in component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
data_4 = Data(data)
data_5 = Data(data_3)
data_6 = Data(data_2)
dumpobjects = HBDumpObjects(
    hb_objs=flatten(model.model),
    name="Default_Room_Multiple_Zones_with_Apertures_default_Climate",
    folder=data_4,
    indent=data_5,
    dump=data_6)  # -> report, hb_file; plug-in component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

box_3 = Box2Pt(PointA="0,0,0", PointB="5,4,3", Plane=PlaneXY(0, 0, 0))
box_4 = Box2Pt(PointA="5,0,0", PointB="12,4,3", Plane=PlaneXY(0, 0, 0))
roomsolid_2 = HBRoomFromSolid(geo=flatten([box_3, box_4]), conditioned=True)  # -> report, rooms; plug-in component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
solveadj_2 = HBSolveAdjacency(rooms=flatten(roomsolid_2.rooms), run=Toggle(True))  # -> report, adj_rooms; plug-in component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
aperturesbyratio_2 = HBAperturesByRatio(hb_objs=flatten(solveadj_2.adj_rooms), ratio="0.45", subdivide=Toggle(False))  # -> report, hb_objs; plug-in component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
ph_bldg_segment_2 = HBPHBldgSegment(hb_rooms=simplify(flatten(aperturesbyratio_2.hb_objs)))  # -> out, hb_rooms; inputs num_floor_levels: Int32, num_dwelling_units: Int32, source_energy_factors: list, co2e_factors: list, hb_rooms: list; same code as ph_bldg_segment
model_2 = HBModel(rooms=flatten(ph_bldg_segment_2.hb_rooms))  # -> report, model; plug-in component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
data_7 = Data(data)
data_8 = Data(data_2)
data_9 = Data(data_3)
panel = Panel("Default_Room_Multiple_Zones_with_Apertures_Single_BldgSegment")
dumpobjects_2 = HBDumpObjects(hb_objs=flatten(model_2.model), name=panel, folder=data_7, indent=data_9, dump=data_8)  # -> report, hb_file; plug-in component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

box_5 = Box2Pt(PointA="0,0,0", PointB="5,4,3", Plane=PlaneXY(0, 0, 0))
roomsolid_3 = HBRoomFromSolid(geo=flatten(box_5), conditioned=True)  # -> report, rooms; plug-in component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
model_3 = HBModel(rooms=flatten(roomsolid_3.rooms))  # -> report, model; plug-in component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
data_10 = Data(data)
data_11 = Data(data_3)
data_12 = Data(data_2)
dumpobjects_3 = HBDumpObjects(hb_objs=flatten(model_3.model), name="Default_Model_Single_Zone", folder=data_10, indent=data_11, dump=data_12)  # -> report, hb_file; plug-in component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

box_6 = Box2Pt(PointA="0,0,0", PointB="5,4,3", Plane=PlaneXY(0, 0, 0))
roomsolid_4 = HBRoomFromSolid(geo=flatten(box_6), conditioned=True)  # -> report, rooms; plug-in component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
data_13 = Data(data)
data_14 = Data(data_3)
data_15 = Data(data_2)
dumpobjects_4 = HBDumpObjects(hb_objs=flatten(roomsolid_4.rooms), name="Default_Room_Single_Zone", folder=data_13, indent=data_14, dump=data_15)  # -> report, hb_file; plug-in component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

box_7 = Box2Pt(PointA="0,0,0", PointB="5,4,3", Plane=PlaneXY(0, 0, 0))
roomsolid_5 = HBRoomFromSolid(geo=flatten(box_7), conditioned=True)  # -> report, rooms; plug-in component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
aperturesbyratio_3 = HBAperturesByRatio(hb_objs=flatten(roomsolid_5.rooms), ratio="0.45", subdivide=Toggle(False))  # -> report, hb_objs; plug-in component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
model_4 = HBModel(rooms=flatten(aperturesbyratio_3.hb_objs))  # -> report, model; plug-in component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
data_16 = Data(data)
data_17 = Data(data_3)
data_18 = Data(data_2)
dumpobjects_5 = HBDumpObjects(
    hb_objs=flatten(model_4.model),
    name="Default_Room_Single_Zone_with_Apertures",
    folder=data_16,
    indent=data_17,
    dump=data_18)  # -> report, hb_file; plug-in component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

box_8 = Box2Pt(PointA="0,0,0", PointB="5,4,3", Plane=PlaneXY(0, 0, 0))
roomsolid_6 = HBRoomFromSolid(geo=flatten(box_8), conditioned=True)  # -> report, rooms; plug-in component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
ln = Line(StartPoint="0,0,0", EndPoint="-20,20,0")
extr = Extrude(Base=ln, Direction="0,0,5")
shade = HBShade(geo=extr)  # -> report, shades; plug-in component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
model_5 = HBModel(rooms=flatten(roomsolid_6.rooms), shades=flatten(shade.shades))  # -> report, model; plug-in component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
data_19 = Data(data)
data_20 = Data(data_3)
data_21 = Data(data_2)
dumpobjects_6 = HBDumpObjects(
    hb_objs=flatten(model_5.model),
    name="Default_Room_Single_Zone_with_Shades",
    folder=data_19,
    indent=data_20,
    dump=data_21)  # -> report, hb_file; plug-in component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

box_9 = Box2Pt(PointA="0,0,0", PointB="5,4,3", Plane=PlaneXY(0, 0, 0))
box_10 = Box2Pt(PointA="5,0,0", PointB="12,4,3", Plane=PlaneXY(0, 0, 0))
roomsolid_7 = HBRoomFromSolid(geo=flatten([box_9, box_10]), conditioned=True)  # -> report, rooms; plug-in component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
solveadj_3 = HBSolveAdjacency(rooms=flatten(roomsolid_7.rooms), run=Toggle(True))  # -> report, adj_rooms; plug-in component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
aperturesbyratio_4 = HBAperturesByRatio(hb_objs=flatten(solveadj_3.adj_rooms), ratio="0.45", subdivide=Toggle(False))  # -> report, hb_objs; plug-in component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
model_6 = HBModel(rooms=flatten(aperturesbyratio_4.hb_objs))  # -> report, model; plug-in component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
data_22 = Data(data)
data_23 = Data(data_3)
data_24 = Data(data_2)
dumpobjects_7 = HBDumpObjects(
    hb_objs=flatten(model_6.model),
    name="Default_Room_Multiple_Zones_with_Apertures",
    folder=data_22,
    indent=data_23,
    dump=data_24)  # -> report, hb_file; plug-in component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

box_11 = Box2Pt(PointA="0,0,0", PointB="5,4,3", Plane=PlaneXY(0, 0, 0))
roomsolid_8 = HBRoomFromSolid(geo=flatten(box_11), conditioned=True)  # -> report, rooms; plug-in component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
panel_2 = Panel("""Room_1
Room_2""")
panel_3 = Panel("""101
102""")
graft = GraftTree(Tree=panel_2, IncludeEmptyLists=True, IncludeNullItems=True)
graft_2 = GraftTree(Tree=panel_3, IncludeEmptyLists=True, IncludeNullItems=True)
create_ph_spaces = HBPHCreateSpaces(flr_seg_geom=simplify(merge_2), space_names=simplify(graft), space_numbers=simplify(graft_2))  # -> out, error, floor_breps, volume_breps, spaces; inputs flr_seg_geom: tree of GeometryBase, weighting_factors: tree, volume_geometry: tree, volume_heights: tree, space_names: tree, space_numbers: tree
# ---------- create_ph_spaces: Python ----------
#
# Honeybee-PH: A Plugin for adding Passive-House data to LadybugTools Honeybee-Energy Models
# 
# This component is part of the PH-Tools toolkit <https://github.com/PH-Tools>.
# 
# Copyright (c) 2022, PH-Tools and bldgtyp, llc <phtools@bldgtyp.com> 
# Honeybee-PH is free software; you can redistribute it and/or modify 
# it under the terms of the GNU General Public License as published 
# by the Free Software Foundation; either version 3 of the License, 
# or (at your option) any later version. 
# 
# Honeybee-PH is distributed in the hope that it will be useful,
# but WITHOUT ANY WARRANTY; without even the implied warranty of 
# MERCHANTABILITY or FITNESS FOR A PARTICULAR PURPOSE. See the 
# GNU General Public License for more details.
# 
# For a copy of the GNU General Public License
# see <https://github.com/PH-Tools/honeybee_ph/blob/main/LICENSE>.
# 
# @license GPL-3.0+ <http://spdx.org/licenses/GPL-3.0+>
#
"""
Create new PH-Spaces. 
-
Spaces represent smaller units than HB-Rooms and can be made up of one or more individual 
volumes. This is useful if you are calculating interior net-floor-area or volume 
as in the Passive House models. Each Space will map to a single entry in the WUFI 
'Ventilation Rooms' or a PHPP 'Additional Ventilation'.
-
A single Space is made of one or more 'Volumes'. ie: a bedroom might have a volume for 
the main space, and another volume for the closet which is separated by the thicknes of 
a wall. 
-
Each Volume is made of one or more floor-segments. Each floor-segment can have a
'weighting factor' applied for calculating the TFA/iCFA for Passive House certification.
-
EM June 10, 2022
    Args:
        _flr_seg_geom: (Tree[Geometry]) The Rhino geometry that you would like to use 
            to create the Floor-Segments of the various Spaces. Each branch should be a list 
            of Rhino geometry objects that will be used to create a single new Space.
        
        _weighting_factors: (Tree[float]) An optional input Tree of TFA/iCFA weighting
            factors to apply to the input floor-segment geometry.
        
        _volume_geometry: (Tree[Geometry]) An optional input Tree of Rhino Geometry
            describing the space-shape of the individual volumes. 
        
        _volume_heights: (Tree[float]) Default=2.5m An optional input Tree of heights
            to use when building the volume geometry.
        
        _space_names: (Tree[float]) Default="_Unnamed_" An optional input Tree of names
            to use when building the spaces
        
        _space_numbers: Default="000" An optional input Tree of space numbers
            to use when building the spaces
    
    Returns:
        floor_breps_: Preview of the Space Floor geometry created. Useful for debugging.
        
        volume_breps_: Preview of the Space Volume geometry created. Useful for debugging.
        
        spaces_: The new PH-Spaces created
"""

import scriptcontext as sc
import Rhino as rh
import rhinoscriptsyntax as rs
import ghpythonlib.components as ghc
import Grasshopper as gh
from Grasshopper import DataTree
from System import Object, Double, String
from Grasshopper.Kernel.Data import GH_Path

from ladybug_rhino.fromgeometry import from_face3d

from honeybee_ph import space
from honeybee_ph_rhino import gh_io
from honeybee_ph_rhino.make_spaces import make_floor, make_volume

# ------------------------------------------------------------------------------
import honeybee_ph_rhino._component_info_
reload(honeybee_ph_rhino._component_info_)
ghenv.Component.Name = "HBPH - Create Spaces"
DEV = True
honeybee_ph_rhino._component_info_.set_component_params(ghenv, dev='JUN_10_2022')
if DEV:
    pass
    #reload(space)
    #reload(gh_io)
    #reload(make_spaces)

# ------------------------------------------------------------------------------
# -- GH Interface
IGH = gh_io.IGH( ghdoc, ghenv, sc, rh, rs, ghc, gh )

# ------------------------------------------------------------------------------
# -- Organize the input trees, lists, lengths, defaults
def clean_input_tree(_input_tree, branch_count, default, type=Object):
    # type (DataTree, int, Any, Any) -> DataTree[<type>]
    """Align the input Datatrees so they are all the same length. Apply defaults."""
    
    new_tree = DataTree[type]()
    for i in range(branch_count):
        try:
            new_tree.AddRange(_input_tree.Branch(i), GH_Path(i))
        except ValueError:
            new_tree.Add(default, GH_Path(i))
    return new_tree

# ------------------------------------------------------------------------------
input_len = len(_flr_seg_geom.Branches)
weighting_factors = clean_input_tree(_weighting_factors, input_len, 1.0, Double)
volume_heights = clean_input_tree(_volume_heights, input_len, 2.5, Double)
space_names = clean_input_tree(_space_names, input_len, '_Unnamed_', String)
space_numbers = clean_input_tree(_space_numbers, input_len, '000', String)

# ------------------------------------------------------------------------------
spaces_ = []
floor_breps_ = DataTree[Object]()
volume_breps_ = DataTree[Object]()
# -- Build one Space for each branch on the _flr_seg_geom input tree
for i, flr_srfc_list in enumerate(_flr_seg_geom.Branches):
    new_space = space.Space()
    new_space.name = space_names.Branch(i)[0]
    new_space.number = space_numbers.Branch(i)[0]
    
    space_floors, e = make_floor.space_floor_from_rh_geom(IGH, list(flr_srfc_list))
    if e:
        error_ = [from_face3d(s) for s in e]
        msg='Error: There was a problem joining together one or more group of floor surfaces?\n'\
            'Check the "error_" output for a preview of the surfaces causing the problem\n'\
            'Check the names and numbers of the surfaces, and make sure they can be properly merged?'
        IGH.error(msg)
    space_volumes = make_volume.volumes_from_floors(IGH, space_floors, volume_heights.Branch(i))
    new_space.add_new_volumes(space_volumes)
    
    spaces_.append(new_space)
    
    # -- Output Preview
    floor_breps_.AddRange([from_face3d(flr.geometry) for flr in space_floors], GH_Path(i))
    for srfc_list in [IGH.convert_to_rhino_geom(vol.geometry) for vol in space_volumes]:
        vol_brep = ghc.BrepJoin(srfc_list).breps
        volume_breps_.Add(vol_brep, GH_Path(i))
# ---------- end create_ph_spaces ----------
add_ph_spaces = HBPHAddSpaces(spaces=create_ph_spaces.spaces, inherit_room_names=Toggle(False), hb_rooms=roomsolid_8.rooms)  # -> out, check_pts, hb_rooms; inputs spaces: list, inherit_room_names: Boolean, hb_rooms: list
# ---------- add_ph_spaces: Python ----------
#
# Honeybee-PH: A Plugin for adding Passive-House data to LadybugTools Honeybee-Energy Models
# 
# This component is part of the PH-Tools toolkit <https://github.com/PH-Tools>.
# 
# Copyright (c) 2022, PH-Tools and bldgtyp, llc <phtools@bldgtyp.com> 
# Honeybee-PH is free software; you can redistribute it and/or modify 
# it under the terms of the GNU General Public License as published 
# by the Free Software Foundation; either version 3 of the License, 
# or (at your option) any later version. 
# 
# Honeybee-PH is distributed in the hope that it will be useful,
# but WITHOUT ANY WARRANTY; without even the implied warranty of 
# MERCHANTABILITY or FITNESS FOR A PARTICULAR PURPOSE. See the 
# GNU General Public License for more details.
# 
# For a copy of the GNU General Public License
# see <https://github.com/PH-Tools/honeybee_ph/blob/main/LICENSE>.
# 
# @license GPL-3.0+ <http://spdx.org/licenses/GPL-3.0+>
#
"""
Add PH-Spaces to honeybee-Rooms. Spaces represent smaller units than HB-Rooms and 
can be made up of one or more individual volumes. This is useful if you are calculating 
interior net-floor-area or volume as in the Passive House models. Each Space will map to 
a single entry in the WUFI 'Ventilation Rooms' or a PHPP 'Additional Ventilation'.
-
EM June 10, 2022
    Args:
        _spaces: (list[Space]) A list of the new PH-Spaces to add to the Honeybee-Rooms.
        
        _offset_dist_: (float) Default=0.1 An optional value to offset the 'test points' being 
            used to determine the right honeybee-Room to host the space in. This value 
            will be used to move the test point 'up' (world Z) by some dimension before 
            testing if it is 'inside' the honeybee-Room. This is useful you drew your
            floor-segments directly 'on' the floor surface of the honeybee room as this 
            sometimes leads to errors when testing for 'inside'.
        
        inherit_room_names_ (bool): default=False. Set to true if you would like all of the 
            PH-Spaces 'in' a Honeybee Room to automatically inherit the display name of the 
            Honeybee Room. Note: this will override any user-defined Space names.
        
        _hb_rooms: (list[Room]) The list of honeybee-Rooms to add to the spaces to.
            
    Returns:
        check_pts_: A preview of the test points being used to evaluate the right
            honeybee-Room to use for the host of the space. Useful for debugging 
            if you run into hosting problems.
            
        hb_rooms_: The honeyee-Rooms with the PH Spaces added to them.
"""

import scriptcontext as sc
import Rhino as rh
import rhinoscriptsyntax as rs
import ghpythonlib.components as ghc
import Grasshopper as gh

from ladybug_rhino.fromgeometry import from_point3d
from honeybee_ph_rhino.make_spaces import make_space

# ------------------------------------------------------------------------------
import honeybee_ph_rhino._component_info_
reload(honeybee_ph_rhino._component_info_)
ghenv.Component.Name = "HBPH - Add Spaces"
DEV = True
honeybee_ph_rhino._component_info_.set_component_params(ghenv, dev='JUN_10_2022')
if DEV:
    #reload(make_space)
    pass

# ------------------------------------------------------------------------------
# -- GH Interface
IGH = honeybee_ph_rhino.gh_io.IGH( ghdoc, ghenv, sc, rh, rs, ghc, gh )

# ------------------------------------------------------------------------------
# -- Clean up the inpt spaces, host in the HB-Rooms
offset_dist = _offset_dist_ or 0.1
spaces = [make_space.offset_space_reference_points(IGH, sp, offset_dist) for sp in _spaces]
hb_rooms_, un_hosted_spaces = make_space.add_spaces_to_honeybee_rooms(spaces, _hb_rooms, inherit_room_names_)

# ------------------------------------------------------------------------------
# -- if any un_hosted_spaces, pull out their center points for troubelshooting
# -- and raise a user-warning
check_pts_ = [from_point3d(lbt_pt) for space_data in  un_hosted_spaces for lbt_pt in space_data.reference_points]
if un_hosted_spaces:
    msg = 'Error: Host Honeybee-Rooms not found for the Spaces: {}'.format('\n'.join([ spd.space.full_name for spd in un_hosted_spaces]))
    IGH.error(msg)
# ---------- end add_ph_spaces ----------
model_7 = HBModel(rooms=flatten(add_ph_spaces.hb_rooms))  # -> report, model; plug-in component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
data_25 = Data(data_2)
data_26 = Data(data)
data_27 = Data(data_3)
dumpobjects_8 = HBDumpObjects(hb_objs=flatten(model_7.model), name="Default_Room_Single_Zone_with_Rooms", folder=data_26, indent=data_27, dump=data_25)  # -> report, hb_file; plug-in component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

box_12 = Box2Pt(PointA="0,0,0", PointB="5,4,3", Plane=PlaneXY(0, 0, 0))
roomsolid_9 = HBRoomFromSolid(geo=flatten(box_12), conditioned=True)  # -> report, rooms; plug-in component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
panel_4 = Panel("""101
102""")
panel_5 = Panel("""Room_1
Room_2""")
graft_3 = GraftTree(Tree=panel_5, IncludeEmptyLists=True, IncludeNullItems=True)
graft_4 = GraftTree(Tree=panel_4, IncludeEmptyLists=True, IncludeNullItems=True)
create_ph_spaces_2 = HBPHCreateSpaces(flr_seg_geom=simplify(merge), space_names=simplify(graft_3), space_numbers=simplify(graft_4))  # -> out, error, floor_breps, volume_breps, spaces; inputs flr_seg_geom: tree of GeometryBase, weighting_factors: tree, volume_geometry: tree, volume_heights: tree, space_names: tree, space_numbers: tree; same code as create_ph_spaces
add_ph_spaces_2 = HBPHAddSpaces(spaces=create_ph_spaces_2.spaces, inherit_room_names=Toggle(False), hb_rooms=roomsolid_9.rooms)  # -> out, check_pts, hb_rooms; inputs spaces: list, inherit_room_names: Boolean, hb_rooms: list; same code as add_ph_spaces
ph_vent_types = HBPHVentTypes({"1-Balanced PH ventilation with HR [Default]": "1", "2-Extract air unit": "2", "3-Only window ventilation": "3"}, selected="1-Balanced PH ventilation with HR [Default]")
create_vent = HBPHCreateVentilationSystem(system_type=ph_vent_types)  # -> out, vent_system
# ---------- create_vent: Python ----------
#
# Honeybee-PH: A Plugin for adding Passive-House data to LadybugTools Honeybee-Energy Models
# 
# This component is part of the PH-Tools toolkit <https://github.com/PH-Tools>.
# 
# Copyright (c) 2022, PH-Tools and bldgtyp, llc <phtools@bldgtyp.com> 
# Honeybee-PH is free software; you can redistribute it and/or modify 
# it under the terms of the GNU General Public License as published 
# by the Free Software Foundation; either version 3 of the License, 
# or (at your option) any later version. 
# 
# Honeybee-PH is distributed in the hope that it will be useful,
# but WITHOUT ANY WARRANTY; without even the implied warranty of 
# MERCHANTABILITY or FITNESS FOR A PARTICULAR PURPOSE. See the 
# GNU General Public License for more details.
# 
# For a copy of the GNU General Public License
# see <https://github.com/PH-Tools/honeybee_ph/blob/main/LICENSE>.
# 
# @license GPL-3.0+ <http://spdx.org/licenses/GPL-3.0+>
#
"""
Create new PH-Style Ventilation Equpment which can be aded to HB-Rooms.
-
EM April 16, 2022
    Args:
        system_name_: (str) The name to give to the fresh-air ventilation system.
            
        system_type_: Choose either -
            1-Balanced PH ventilation with HR [Default]
            2-Extract air unit
            3-Only window ventilation
        
        vent_unit_: (Optional[]) The Venilator (ERV/HRV) to use to ventilate the
            honeybee-Rooms.
        
        duct_01_: The supply cold-air duct (from ventilator to the building-envelope)
        
        duct_02_: The exhaust cold-air duct (from ventilator to the building-envelope)
        
    Returns:
        vent_system_: The new HBPH Ventilation System object.
"""

from honeybee_energy_ph.hvac import ventilation
from honeybee_ph_utils import preview

# --- 
import honeybee_ph_rhino._component_info_
reload(honeybee_ph_rhino._component_info_)
ghenv.Component.Name = "HBPH - Create Ventilation System"
DEV = True
honeybee_ph_rhino._component_info_.set_component_params(ghenv, dev='APR_16_2022')
if DEV:
    reload(ventilation)
    reload(preview)

# ------------------------------------------------------------------------------
# -- Build a new Passive House style ventilation system
vent_system_ = ventilation.PhVentilationSystem()
vent_system_.display_name = system_name_ or vent_system_.display_name
vent_system_.sys_type = system_type_ or 1
vent_system_.ventilation_unit = vent_unit_ or ventilation.Ventilator()

# ------------------------------------------------------------------------------
preview.object_preview(vent_system_)
# ---------- end create_vent ----------
add_mech = HBPHAddMechSystems(vent_system=create_vent.vent_system, hb_rooms=add_ph_spaces_2.hb_rooms)  # -> out, hb_rooms; inputs space_heating_systems: list, space_cooling_systems: list, hb_rooms: list
# ---------- add_mech: Python ----------
#
# Honeybee-PH: A Plugin for adding Passive-House data to LadybugTools Honeybee-Energy Models
# 
# This component is part of the PH-Tools toolkit <https://github.com/PH-Tools>.
# 
# Copyright (c) 2022, PH-Tools and bldgtyp, llc <phtools@bldgtyp.com> 
# Honeybee-PH is free software; you can redistribute it and/or modify 
# it under the terms of the GNU General Public License as published 
# by the Free Software Foundation; either version 3 of the License, 
# or (at your option) any later version. 
# 
# Honeybee-PH is distributed in the hope that it will be useful,
# but WITHOUT ANY WARRANTY; without even the implied warranty of 
# MERCHANTABILITY or FITNESS FOR A PARTICULAR PURPOSE. See the 
# GNU General Public License for more details.
# 
# For a copy of the GNU General Public License
# see <https://github.com/PH-Tools/honeybee_ph/blob/main/LICENSE>.
# 
# @license GPL-3.0+ <http://spdx.org/licenses/GPL-3.0+>
#
"""
Add HBPH mechanical ventilation, heating, and cooling to HB-Rooms.
-
EM April 16, 2022
    Args:
        _vent_system: (PhVentilationSystem) Enter the type of heating system.
        
        _space_heating_systems: (list[PhHeatingSystem]) A list of the HBPH Heating Systems to add to the hb-rooms.
        
        _space_cooling_systems: (list[PhCoolingSystem]) A list of the HBPH Cooling Systems to add to the hb-rooms.
        
        _hb_rooms: (list[Room]) A list of the hb-rooms to add the mechanical systems to.
        
    Returns:
        hb_rooms_: The input hb-rooms with the new HBPH Mechanical Systems added.
"""

from copy import copy

#-------------------------------------------------------------------------------
import honeybee_ph_rhino._component_info_
reload(honeybee_ph_rhino._component_info_)
ghenv.Component.Name = "HBPH - Add Mech Systems"
DEV = True
honeybee_ph_rhino._component_info_.set_component_params(ghenv, dev='APR_16_2022')
if DEV:
    pass


#-------------------------------------------------------------------------------
hb_rooms_ = []
for hb_room in _hb_rooms:
    # -- Build up the new HB-HVAC
    new_hvac = copy(hb_room.properties.energy.hvac.duplicate())
    
    # --------------------------------------------------------------------------
    # -- Fresh-Air Ventilation
    if _vent_system: print 'True=', _vent_system
    if _vent_system:
        new_hvac.properties.ph.ventilation_system = _vent_system
        
        
        if _vent_system.ventilation_unit:
            # -- Set the new h-hvac's values to match the PH-Ventilator Inputs, if any
            
            new_hvac.sensible_heat_recovery = _vent_system.ventilation_unit.sensible_heat_recovery
            new_hvac.latent_heat_recovery = _vent_system.ventilation_unit.latent_heat_recovery
            new_hvac.demand_controlled_ventilation = True
    
    # --------------------------------------------------------------------------
    # -- Space Heating
    for ph_heating_system in _space_heating_systems:
        new_hvac.properties.ph.heating_systems.add(ph_heating_system)
        
    # --------------------------------------------------------------------------
    # -- Space Cooling
    for ph_cooling_system in _space_cooling_systems:
        new_hvac.properties.ph.cooling_systems.add(ph_cooling_system)    
    
    new_room = hb_room.duplicate()
    new_room.properties.energy.hvac = new_hvac
    hb_rooms_.append(new_room)
# ---------- end add_mech ----------
model_8 = HBModel(rooms=flatten(add_mech.hb_rooms))  # -> report, model; plug-in component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
data_28 = Data(data_2)
data_29 = Data(data)
data_30 = Data(data_3)
dumpobjects_9 = HBDumpObjects(
    hb_objs=flatten(model_8.model),
    name="Default_Room_Single_Zone_with_Ventilation",
    folder=data_29,
    indent=data_30,
    dump=data_28)  # -> report, hb_file; plug-in component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

panel_6 = Panel(path)

planesrf_5 = PlaneSurface(Plane="1,1,0", XSize="1", YSize="1")
planesrf_6 = PlaneSurface(Plane="2,2,0", XSize="1", YSize="1")
merge_3 = Merge(Data1=planesrf_5, Data2=planesrf_6)  # -> graft(Result)

list = ValueList({"1-Passive House", "2-EnerPHit", "3-PHI Low Energy Building", "4-Other"}, selected="1-Passive House")
list_2 = ValueList({"1-Component method", "2-Energy demand method"}, selected="2-Energy demand method")
list_3 = ValueList({"1-New building", "2-Retrofit", "3-Step-by-step retrofit"}, selected="1-New building")
list_4 = ValueList({"1-PE (non-renewable)", "2-PER (renewable)"}, selected="1-PE (non-renewable)")
list_5 = ValueList({"1-Classic", "2-Plus", "3-Premium"}, selected="1-Classic")

box_13 = Box2Pt(PointA="0,0,0", PointB="5,4,3", Plane=PlaneXY(0, 0, 0))
box_14 = Box2Pt(PointA="5,0,0", PointB="12,4,3", Plane=PlaneXY(0, 0, 0))
roomsolid_10 = HBRoomFromSolid(geo=flatten([box_13, box_14]), conditioned=True)  # -> report, rooms; plug-in component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
solveadj_4 = HBSolveAdjacency(rooms=flatten(roomsolid_10.rooms), run=Toggle(True))  # -> report, adj_rooms; plug-in component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
aperturesbyratio_5 = HBAperturesByRatio(hb_objs=flatten(solveadj_4.adj_rooms), ratio="0.45", subdivide=Toggle(False))  # -> report, hb_objs; plug-in component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
ph_vent_types_2 = HBPHVentTypes({"1-Balanced PH ventilation with HR [Default]": "1", "2-Extract air unit": "2", "3-Only window ventilation": "3"}, selected="1-Balanced PH ventilation with HR [Default]")
create_vent_2 = HBPHCreateVentilationSystem(system_type=ph_vent_types_2)  # -> out, vent_system; same code as create_vent
phi_cert = HBPHPHICertification(certification_type=list, certification_class=list_5, primary_energy_type=list_4, enerphit_type=list_2, retrofit=list_3)  # -> out, phi_certification
# ---------- phi_cert: Python ----------
#
# Honeybee-PH: A Plugin for adding Passive-House data to LadybugTools Honeybee-Energy Models
# 
# This component is part of the PH-Tools toolkit <https://github.com/PH-Tools>.
# 
# Copyright (c) 2022, PH-Tools and bldgtyp, llc <phtools@bldgtyp.com> 
# Honeybee-PH is free software; you can redistribute it and/or modify 
# it under the terms of the GNU General Public License as published 
# by the Free Software Foundation; either version 3 of the License, 
# or (at your option) any later version. 
# 
# Honeybee-PH is distributed in the hope that it will be useful,
# but WITHOUT ANY WARRANTY; without even the implied warranty of 
# MERCHANTABILITY or FITNESS FOR A PARTICULAR PURPOSE. See the 
# GNU General Public License for more details.
# 
# For a copy of the GNU General Public License
# see <https://github.com/PH-Tools/honeybee_ph/blob/main/LICENSE>.
# 
# @license GPL-3.0+ <http://spdx.org/licenses/GPL-3.0+>
#
"""
Enter the relevant Phius Certification threshold data for the building-segment.
-
EM June 4, 2022
    Args:
        _building_category_type: Input either -
            "1-Residential building" (default)
            "2-Non-residential building"
        
        _building_use_type: Input either - 
            "10-Dwelling" (default)
            "11-Nursing home / students"
            "12-Other"
            "20-Office / Admin. building"
            "21-School"
            "22-Other"
            
        _ihg_type: Input either-
            "2-Standard" (default),
            "3-PHPP calculation ('IHG' worksheet)",
            "4-PHPP calculation ('IHG non-res' worksheet)",
            
        _occupancy_type: Input either-
            "1-Standard (only for residential buildings)",
            "2-User determined",
        
        _certification_type: Input either -
            "1-Passive House" (default)
            "2-EnerPHit"
            "3-PHI Low Energy Building"
            "4-Other"

        _certification_class: Input either -
            "1-Classic" (default)
            "2-Plus"
            "3-Premium"

        _primary_energy_type: Input either -
            "1-PE (non-renewable)"
            "2-PER (renewable)" (default)

        _enerphit_type: Input either -
            "1-Component method"
            "2-Energy demand method" (default)

        _retrofit: Input either -
            "1-New building" (default)
            "2-Retrofit"
            "3-Step-by-step retrofit"

    Returns:
        phi_certification_: The PHI Certification Settings object to 
            assign to one or more Building Segments.
"""


from honeybee_ph_rhino import gh_io
from honeybee_ph_utils import preview, enumerables
from honeybee_ph import phi


#-------------------------------------------------------------------------------
import honeybee_ph_rhino._component_info_
reload(honeybee_ph_rhino._component_info_)
ghenv.Component.Name = "HBPH - PHI Certification"
DEV = True
honeybee_ph_rhino._component_info_.set_component_params(ghenv, dev='JUN_04_2022')
if DEV:
    reload(enumerables)
    reload(gh_io)
    reload(preview)
    reload(phi)


#-------------------------------------------------------------------------------
phi_certification_ =  phi.PhiCertification()

phi_certification_.building_category_type = gh_io.input_to_int(_building_category_type)
phi_certification_.building_use_type = gh_io.input_to_int(_building_use_type)
phi_certification_.ihg_type = gh_io.input_to_int(_ihg_type)
phi_certification_.occupancy_type = gh_io.input_to_int(_occupancy_type)

phi_certification_.certification_type = gh_io.input_to_int(_certification_type)
phi_certification_.certification_class = gh_io.input_to_int(_certification_class)
phi_certification_.primary_energy_type = gh_io.input_to_int(_primary_energy_type)
phi_certification_.enerphit_type = gh_io.input_to_int(_enerphit_type)
phi_certification_.retrofit_type = gh_io.input_to_int(_retrofit)

#-------------------------------------------------------------------------------
preview.object_preview(phi_certification_)
# ---------- end phi_cert ----------
hbph_phius_climate_2 = HBPHPhiusClimate()  # -> out, ph_climate; inputs copy_from_excel: list; same code as hbph_phius_climate
data_31 = Data(data)
data_32 = Data(data_3)
data_33 = Data(data_2)

panel_7 = Panel("""101
102""")
panel_8 = Panel("""Room_1
Room_2""")
graft_5 = GraftTree(Tree=panel_8, IncludeEmptyLists=True, IncludeNullItems=True)
graft_6 = GraftTree(Tree=panel_7, IncludeEmptyLists=True, IncludeNullItems=True)
create_ph_spaces_3 = HBPHCreateSpaces(flr_seg_geom=simplify(merge_3), space_names=simplify(graft_5), space_numbers=simplify(graft_6))  # -> out, error, floor_breps, volume_breps, spaces; inputs flr_seg_geom: tree of GeometryBase, weighting_factors: tree, volume_geometry: tree, volume_heights: tree, space_names: tree, space_numbers: tree; same code as create_ph_spaces
add_ph_spaces_3 = HBPHAddSpaces(spaces=create_ph_spaces_3.spaces, inherit_room_names=Toggle(False), hb_rooms=aperturesbyratio_5.hb_objs)  # -> out, check_pts, hb_rooms; inputs spaces: list, inherit_room_names: Boolean, hb_rooms: list; same code as add_ph_spaces

add_mech_2 = HBPHAddMechSystems(vent_system=create_vent_2.vent_system, hb_rooms=add_ph_spaces_3.hb_rooms)  # -> out, hb_rooms; inputs space_heating_systems: list, space_cooling_systems: list, hb_rooms: list; same code as add_mech
ph_bldg_segment_3 = HBPHBldgSegment(
    climate=hbph_phius_climate_2.ph_climate,
    phi_certification=phi_cert.phi_certification,
    hb_rooms=simplify(flatten(add_mech_2.hb_rooms)))  # -> out, hb_rooms; inputs num_floor_levels: Int32, num_dwelling_units: Int32, source_energy_factors: list, co2e_factors: list, hb_rooms: list; same code as ph_bldg_segment
model_9 = HBModel(rooms=flatten(ph_bldg_segment_3.hb_rooms))  # -> report, model; plug-in component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
dumpobjects_10 = HBDumpObjects(
    hb_objs=flatten(model_9.model),
    name="Default_Room_Multiple_Zones_with_PHI_Cert",
    folder=data_31,
    indent=data_32,
    dump=data_33)  # -> report, hb_file; plug-in component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
